# Grasshopper definition 533-w2-yiwei.gh (Grasshopper 1.0.7)

# ----
# Input Area - Slots & Size
number_slider = Slider(0.1, range=0..2)

# ----
# Input Area - Shape & Size
number_slider_2 = Slider(1, range=0..1.5)
point = Point(Point(0, 0, 0))

vector_xyz = VectorXYZ(XComponent=Slider(0.5, range=0..4), YComponent=Slider(0, range=0..4), ZComponent=0)  # -> Vector, Length
rectangle = Rectangle(Plane=PlaneXY(0, 0, 0), XSize=number_slider, YSize=Slider(1, range=0..2), Radius=Slider(0.02, range=0..100))  # -> Rectangle, Length
polygon = Polygon(Plane=point, Radius=number_slider_2, Segments=Slider(6, range=0..12), FilletRadius=Slider(0.1, range=0..100))  # -> Polygon, Length
radians = Radians(Degrees=Slider(0, range=0..100))
move = Move(Geometry=rectangle.Rectangle, Motion=vector_xyz.Vector)  # -> Geometry, Transform
rotate = Rotate(Geometry=polygon.Polygon, Angle=radians, Plane=PlaneXY(0, 0, 0))  # -> Geometry, Transform
polar_array = PolarArray(Geometry=move.Geometry, Plane=PlaneXY(0, 0, 0), Count=Slider(3, range=0..10), Angle=6.283185307)  # -> Geometry, Transform
trim_with_regions = TrimWithRegions(Curve=rotate.Geometry, Regions=polar_array.Geometry)  # -> Inside, Outside
trim_with_regions_2 = TrimWithRegions(Curve=polar_array.Geometry, Regions=rotate.Geometry)  # -> flatten(Inside), Outside
# Final Step - Bake Here
join_curves = JoinCurves(Curves=[trim_with_regions.Outside, trim_with_regions_2.Inside], Preserve=False)
