# Grasshopper definition snowflake.gh (Grasshopper 1.0.7)

# ----
# The size of 3 branches
number_slider = Slider(83, range=0..100)

# ----
# The angle and interval of 3 branches
number_slider_2 = Slider(11, range=0..100)

construct_point = ConstructPoint(XCoordinate=0, YCoordinate=0, ZCoordinate=0)
unit_x = UnitX(Factor=Slider(40, range=0..100))
unit_x_2 = UnitX(Factor=number_slider)
point = Point(construct_point)

# ----
# The size of the center and edge polygen
number_slider_3 = Slider(18, range=0..20)

vector_xyz = VectorXYZ(XComponent=number_slider_2, YComponent=Slider(15, range=0..100), ZComponent=0)  # -> Vector, Length
move = Move(Geometry=point, Motion=unit_x)  # -> Geometry, Transform
move_2 = Move(Geometry=point, Motion=unit_x_2)  # -> Geometry, Transform
move_3 = Move(Geometry=move.Geometry, Motion=vector_xyz.Vector)  # -> Geometry, Transform

# ----
# The amount of snowflake petal
number_slider_4 = Slider(6, range=0..10)

polygon = Polygon(Plane=point, Radius=number_slider_3, Segments=6, FilletRadius=0)  # -> Polygon, Length
polygon_2 = Polygon(Plane=move_2.Geometry, Radius=Slider(8, range=0..20), Segments=6, FilletRadius=0)  # -> Polygon, Length
line = Line(StartPoint=point, EndPoint=move_2.Geometry)
unit_x_3 = UnitX(Factor=Slider(13, range=0..100))
line_2 = Line(StartPoint=move.Geometry, EndPoint=move_3.Geometry)
move_4 = Move(Geometry=line_2, Motion=unit_x_3)  # -> Geometry, Transform
division = Division(A="360", B=number_slider_4)
move_5 = Move(Geometry=move_4.Geometry, Motion=unit_x_3)  # -> Geometry, Transform
number_slider_5 = Slider(1, range=0..10)
series = Series(Start=0, Step=division, Count=number_slider_4)
end_points = EndPoints(Curve=move_4.Geometry)  # -> Start, End
end_points_2 = EndPoints(Curve=move_5.Geometry)  # -> Start, End
degrees = Degrees(Radians=series)
addition = Addition(A=number_slider_5, B=Slider(0.4, range=0..1))
scale = Scale(Geometry=move_4.Geometry, Center=end_points.Start, Factor=number_slider_5)  # -> Geometry, Transform
scale_2 = Scale(Geometry=move_5.Geometry, Center=end_points_2.Start, Factor=addition)  # -> Geometry, Transform

# ----
# The height of snowflake
number_slider_6 = Slider(2, range=0..10)

curve = Curve([line_2, scale.Geometry, scale_2.Geometry])

panel = Panel("Thickness of snowflake")
number_slider_7 = Slider(7.3, range=0..10)

mirror_curve = MirrorCurve(Geometry=curve, Curve=line, Tangent=True)
unit_z = UnitZ(Factor=number_slider_6)
curve_2 = Curve(flatten([curve, mirror_curve, line]))
negative = Negative(Value=number_slider_7)
offset_curve = OffsetCurve(Curve=curve_2, Distance=number_slider_7, Corners=1)
offset_curve_2 = OffsetCurve(Curve=curve_2, Distance=negative, Corners=1)
loft = Loft(
    Curves=[offset_curve_2, offset_curve],
    Options={Adjust=False, Closed=False, LoftEnds=0, LoftSimp=0, LoftType=0, Rebuild=10, Refit=0.01})
region_union = RegionUnion(Curves=flatten([polygon_2.Polygon, polygon.Polygon, loft]))
fillet = Fillet(Curve=region_union, Radius=Slider(2, range=0..10))
rotate = Rotate(Geometry=fillet, Angle=degrees(series), Plane=point)  # -> Geometry, Transform
boundary_surfaces = BoundarySurfaces(Edges=rotate.Geometry)
region_union_2 = RegionUnion(Curves=flatten(boundary_surfaces))
extrude = Extrude(Base=region_union_2, Direction=unit_z)
solid_union = SolidUnion(Breps=flatten(extrude))
merge_faces = MergeFaces(Brep=solid_union)  # -> Breps, Before, After
